# Grasshopper definition ghfile.gh (Grasshopper 1.0.8)

aerofoil_file = FilePath("C:\Users\oran\Desktop\EDF Drone\e67.dat")
aerofoil_file_2 = FilePath("C:\Users\oran\Desktop\EDF Drone\n0012.dat")
file = ReadFile(File=aerofoil_file, PerLineParse=True)
file_2 = ReadFile(File=aerofoil_file_2, PerLineParse=True)
trim = TextTrim(Text=file, Start=True, End=True)
trim_2 = TextTrim(Text=file_2, Start=True, End=True)
split = SplitList(List=trim, Index="2")  # -> ListA, ListB
split_2 = SplitList(List=trim_2, Index="1")  # -> ListA, ListB
space = Text(" ")
space_2 = Text(" ")
split_3 = TextSplit(Text=split.ListB, Separators=space)
split_4 = TextSplit(Text=split_2.ListB, Separators=space_2)
item = ListItem(List=split_3, Index=0, Wrap=True)  # -> Item, Item1
item_2 = ListItem(List=split_4, Index=0, Wrap=True)  # -> Item, Item1
x_values = Text(flatten(item.Item))
z_values = Text(flatten(item.Item1))
x_values_2 = Text(flatten(item_2.Item))
z_values_2 = Text(flatten(item_2.Item1))
foil_points = ConstructPoint(XCoordinate=x_values, YCoordinate=0, ZCoordinate=z_values)
foil_points_2 = ConstructPoint(XCoordinate=x_values_2, YCoordinate=0, ZCoordinate=z_values_2)
intcrv = Interpolate(Vertices=foil_points, Degree=3, Periodic=False, KnotStyle=1)  # -> Curve, Length, Domain
